# Grasshopper definition Curved Folding.gh (Grasshopper 1.0.7)
# plug-ins: MeshEdit Components, Kangaroo Components, Kangaroo2 Components

number_slider = Slider(100, range=0..100)

reset_simulation = Button()
folding_degree = Slider(155.9, range=0..170)

number_slider_2 = Slider(1, range=0..10)
number_slider_3 = Slider(30, range=0..30)
crv = Curve(<curve referenced from the Rhino model>)
planesrf = PlaneSurface(Plane=PlaneXY(0, 0, 0), XSize=number_slider, YSize=number_slider)
sdivide = DivideSurface(Surface=planesrf, UCount=number_slider_2, VCount=number_slider_3)  # -> simplify(Points), Normals, Parameters
addition = Addition(A=number_slider_2, B=1)
addition_2 = Addition(A=number_slider_3, B=1)
frompoints = MeshFromPoints(Points=flatten(sdivide.Points), UDirection=addition, VDirection=addition_2)  # -> simplify(Mesh)
meshtonurb = MeshToNurb(m=frompoints)  # -> out, a
# ---------- meshtonurb: Python ----------
import rhinoscriptsyntax as rs

a = rs.MeshToNurb(m)
# ---------- end meshtonurb ----------
debrep = DeconstructBrep(Brep=meshtonurb.a)  # -> Faces, Edges, Vertices
bcx = BrepCurve(Brep=meshtonurb.a, Curve=crv)  # -> Curves, Points
srfsplit = SurfaceSplit(Surface=debrep.Faces, Curves=bcx.Curves)
explode = Explode(Curve=srfsplit, Recursive=True)  # -> simplify(Segments), Vertices
removeduplicatepts = RemoveDuplicatePts(Points=explode.Vertices, Tolerance=0.01)
duppt = RemoveDuplicatePts(Points=explode.Vertices, Tolerance=0.01)
end = EndPoints(Curve=explode.Segments)  # -> Start, End
dispatch = Dispatch(List=removeduplicatepts, DispatchPattern=[True, False])  # -> ListA, ListB
ln = Line(StartPoint=end.Start, EndPoint=end.End)
pline = PolyLine(Vertices=dispatch.ListA, Closed=False)
pline_2 = PolyLine(Vertices=dispatch.ListB, Closed=False)
merge = Merge(Data1=pline, Data2=pline_2, Data3=ln)
join = JoinCurves(Curves=ln, Preserve=False)  # -> simplify(Curves)
boundary = BoundarySurfaces(Edges=join)
pshift = ShiftPaths(Data=boundary, Offset=-1)
item = ListItem(List=pshift, Index=1, Wrap=True)
item_2 = ListItem(List=pshift, Index=0, Wrap=True)
flip = Flip(Surface=item)  # -> Surface, Result
merge_2 = Merge(Data1=item_2, Data2=flip.Surface)
flatten = FlattenTree(Tree=merge, Path="{0}")
flip_2 = FlipMatrix(Data=merge_2)
number_slider_4 = Slider(1, range=0..1)
removeduplicatelines = RemoveDuplicateLines(Lines=flatten, Tolerance=0.01)
dupln = RemoveDuplicateLines(Lines=flatten, Tolerance=0.01)
join_2 = BrepJoin(Breps=flip_2)  # -> Breps, Closed
pshift_2 = ShiftPaths(Data=join, Offset=-1)
length_line = LengthLine(Line=removeduplicatelines, Strength=10)
boundary_2 = BoundarySurfaces(Edges=pshift_2)
smesh = SimpleMesh(Brep=join_2.Breps)
join_3 = BrepJoin(Breps=boundary_2)  # -> Breps, Closed
edges = BrepEdges(Brep=join_3.Breps)  # -> Naked, Interior, NonManifold
meshnormalize = MeshNormalize(mesh=smesh)  # -> out, A; inputs mesh: Mesh
# ---------- meshnormalize: C# ----------
    if(mesh != null){
      mesh.Normals.ComputeNormals();

      A = mesh;
    }
# ---------- end meshnormalize ----------
box_corners = BoxCorners(Box=join_3.Breps)  # -> CornerA, CornerB, CornerC, CornerD, CornerE, CornerF, CornerG, CornerH
rad = Radians(Degrees=folding_degree)
ln_2 = Line(StartPoint=box_corners.CornerF, EndPoint=box_corners.CornerG)
ln_3 = Line(StartPoint=box_corners.CornerA, EndPoint=box_corners.CornerD)
join_4 = JoinCurves(Curves=flatten(edges.Interior), Preserve=False)
end_2 = EndPoints(Curve=edges.Interior)  # -> Start, End
flatten_2 = FlattenTree(Tree=ln_3, Path="{0}")
flatten_3 = FlattenTree(Tree=ln_2, Path="{0}")
explode_2 = Explode(Curve=join_4, Recursive=True)  # -> Segments, Vertices
shift = ShiftList(List=explode_2.Segments, Shift=-1, Wrap=False)
shift_2 = ShiftList(List=explode_2.Segments, Shift=1, Wrap=False)
shift_3 = ShiftList(List=flatten_2, Shift=-1, Wrap=False)
shift_4 = ShiftList(List=flatten_2, Shift=1, Wrap=False)
shift_5 = ShiftList(List=flatten_3, Shift=-1, Wrap=False)
shift_6 = ShiftList(List=flatten_3, Shift=1, Wrap=False)
graft = GraftTree(Tree=shift_2, IncludeEmptyLists=True, IncludeNullItems=True)  # -> simplify(Tree)
graft_2 = GraftTree(Tree=shift, IncludeEmptyLists=True, IncludeNullItems=True)  # -> simplify(Tree)
graft_3 = GraftTree(Tree=shift_4, IncludeEmptyLists=True, IncludeNullItems=True)  # -> simplify(Tree)
number_slider_5 = Slider(1, range=0..1)
graft_4 = GraftTree(Tree=shift_3, IncludeEmptyLists=True, IncludeNullItems=True)  # -> simplify(Tree)
graft_5 = GraftTree(Tree=shift_6, IncludeEmptyLists=True, IncludeNullItems=True)  # -> simplify(Tree)
graft_6 = GraftTree(Tree=shift_5, IncludeEmptyLists=True, IncludeNullItems=True)  # -> simplify(Tree)
ph = PlasticHinge(
    FoldStart=end_2.Start,
    FoldEnd=end_2.End,
    Tip1=box_corners.CornerD,
    Tip2=box_corners.CornerF,
    RestAngle=rad,
    Limit=rad,
    Strength=number_slider_4)
ph_2 = PlasticHinge(
    FoldStart=end_2.Start,
    FoldEnd=end_2.End,
    Tip1=box_corners.CornerA,
    Tip2=box_corners.CornerG,
    RestAngle=rad,
    Limit=rad,
    Strength=number_slider_4)
angle = Angle(VectorA=graft_4, VectorB=graft_3)  # -> Angle, Reflex
angle_2 = Angle(VectorA=graft_6, VectorB=graft_5)  # -> Angle, Reflex
angle_3 = Angle(VectorA=graft_2, VectorB=graft)  # -> Angle, Reflex
angle_4 = Angle(LineA=graft_4, LineB=graft_3, Strength=number_slider_5)
angle_5 = Angle(LineA=graft_2, LineB=graft, RestAngle=angle_3.Angle, Strength=Slider(1, range=0..1))
angle_6 = Angle(LineA=graft_6, LineB=graft_5, Strength=number_slider_5)
floor = Floor(Strength=1)
show = Show(G=meshnormalize.A)
merge_3 = Merge(Data1=angle_4, Data2=angle_6, Data3=angle_5)
merge_4 = Merge(
    Data1=flatten(show),
    Data2=flatten(length_line),
    Data3=flatten(ph_2),
    Data4=flatten(ph),
    Data5=flatten(merge_3),
    Data6=flatten(floor))
solver = Solver(GoalObjects=merge_4, Reset=reset_simulation, Threshold=1e-15, Tolerance=0.01, On=Toggle(True))  # -> I, V, O
subset = SubList(List=solver.O, Domain=Domain(0, 1), Wrap=True)  # -> List, Index
weld = WeldMesh(Mesh=subset.List, Angle=3.141592654)
preview = CustomPreview(Geometry=weld, Shader=ColourSwatch(SwatchColor=RGB(0, 158, 201)))
