# Grasshopper definition unnamed.gh (Grasshopper 1.0.7)

md_slider = MDSlider(
    SliderMode=0,
    slider_value=Point(0.5240508289, 0.5320121951, 0.5),
    x_domain=Domain(-2000, 2000),
    y_domain=Domain(-2000, 2000),
    z_domain=Domain(0, 1))
panel = Panel("-1000")
xy = XYPlane(Origin=Point(0, 0, 0))
xz = XZPlane(Origin=Point(0, 0, 0))
move = Move(Geometry=xy, Motion=md_slider)  # -> Geometry, Transform
X = XSize()
Y = YSize()
planesrf = PlaneSurface(Plane=move.Geometry, XSize=X, YSize=Y)
P = Plane(planesrf)
U = UCount()
V = VCount()
sdivide = DivideSurface(Surface=planesrf, UCount=U, VCount=V)  # -> Points, Normals, Parameters
P_2 = Points(sdivide.Points)
pdecon = Deconstruct(Point=sdivide.Points)  # -> XComponent, YComponent, ZComponent
bnd = Bounds(Numbers=flatten(pdecon.XComponent))
bnd_2 = Bounds(Numbers=flatten(pdecon.YComponent))
remap = RemapNumbers(Value=pdecon.YComponent, Source=bnd_2, Target="0 to 1")  # -> Mapped, Clipped
remap_2 = RemapNumbers(Value=pdecon.XComponent, Source=bnd, Target="0 to 1")  # -> Mapped, Clipped
pt = ConstructPoint(XCoordinate=remap_2.Mapped, YCoordinate=remap.Mapped, ZCoordinate=0)
pt_2 = Point(pt)
