# Grasshopper definition waffle_ripple.gh (Grasshopper 1.0.7)

trim_da_boring_square = BooleanToggle(False)
z_stretch_factor = Slider(60, range=1..60)
value_list = ValueList({"Extruded": 0, "Flat": 1, "Mirrored": 2}, selected="Extruded")
# *ALL IN MILLIMETERS (MM)
square_size = Slider(250, range=0..250)
uv_count = Slider(13, range=0..100)
extrusion = Slider(10, range=5..100)

# ----
# RIGHT CLICK "TRIM CURVE"
# then
# "SET ONE CURVE"
trim_curve = Curve(<curve referenced from the Rhino model>)

cluster = Cluster(X=square_size, Y=square_size, U=uv_count, V=uv_count)  # -> P, P_2, pt_2
number = Number(value_list)
image_sampler = ImageSampler(
    cluster.pt_2,
    FilePath="C:\Users\25876\Downloads\waffle_emk\img\valley.jpg",
    Filter="Value",
    Interpolate=False,
    Umax=1,
    Umin=0,
    Vmax=1,
    Vmin=0,
    Wrap=1)
graph_mapper = GraphMapper(
    image_sampler,
    x0=0,
    x1=1,
    y0=0,
    y1=1,
    container_name="Bezier",
    cpx=[0, 0.4420289993, 0.8407610655, 1],
    cpy=[0, 0.4169611335, 0.4291520119, 1])
md_slider = MDSlider(
    SliderMode=0,
    slider_value=Point(0.03428984851, 0.3075799709, 0.5),
    x_domain=Domain(0, 1),
    y_domain=Domain(0, 1),
    z_domain=Domain(0, 1))
xz_plane = XZPlane(Origin=Point(0, 0, 0))
md_slider_2 = MDSlider(
    SliderMode=0,
    slider_value=Point(0.808232005, 0.7356716249, 0.5),
    x_domain=Domain(0, 1),
    y_domain=Domain(0, 1),
    z_domain=Domain(0, 1))
xy_plane = XYPlane(Origin=Point(0, 0, 0))
md_slider_3 = MDSlider(
    SliderMode=0,
    slider_value=Point(1, 0.295834425, 0.5),
    x_domain=Domain(0, 1),
    y_domain=Domain(0, 1),
    z_domain=Domain(0, 1))
# BUG: Needs some displacement in the Z for flat bottom option
panel = Panel("(x*y) +z")
md_slider_4 = MDSlider(
    SliderMode=0,
    slider_value=Point(0.1158536585, 0.06097560976, 0.5),
    x_domain=Domain(0, 1),
    y_domain=Domain(0, 1),
    z_domain=Domain(0, 1))
rectangle = Rectangle(Plane=xy_plane, XSize=Slider(168, range=0..300), YSize=Slider(260, range=0..300), Radius=0)  # -> Rectangle, Length
evaluate = Evaluate(Expression=panel, Variable_x=graph_mapper, Variable_y=z_stretch_factor, z="4")
md_slider_5 = MDSlider(
    SliderMode=0,
    slider_value=Point(0.614299495, 0.7152367569, 0.5),
    x_domain=Domain(0, 1),
    y_domain=Domain(0, 1),
    z_domain=Domain(0, 1))
number_slider = Slider(50, range=0..100)
merge = Merge(Data1=md_slider, Data2=md_slider_3, Data3=md_slider_5)
unit_z = UnitZ(Factor=evaluate)
bounds = Bounds(Numbers=flatten(evaluate))
boundary_surfaces = BoundarySurfaces(Edges=rectangle.Rectangle)
merge_2 = Merge(Data1=md_slider_2, Data2=md_slider_4)
move = Move(Geometry=cluster.P_2, Motion=unit_z)  # -> Geometry, Transform
evaluate_surface = EvaluateSurface(Surface=reparameterize(boundary_surfaces), Point=merge)  # -> Point, Normal, UDirection, VDirection, Frame
panel_2 = Panel(bounds)
surface_from_points = SurfaceFromPoints(Points=flatten(move.Geometry), UCount=expr("x+1", uv_count), Interpolate=False)
evaluate_surface_2 = EvaluateSurface(Surface=reparameterize(boundary_surfaces), Point=merge_2)  # -> Point, Normal, UDirection, VDirection, Frame
divide_surface = DivideSurface(Surface=boundary_surfaces, UCount=number_slider, VCount=Slider(32, range=0..100))  # -> flatten(Points), Normals, Parameters
pull_point = PullPoint(Point=divide_surface.Points, Geometry=evaluate_surface.Point, ClosestOnly=True)  # -> ClosestPoint, Distance
pull_point_2 = PullPoint(Point=divide_surface.Points, Geometry=evaluate_surface_2.Point, ClosestOnly=True)  # -> ClosestPoint, Distance
construct_domain = ConstructDomain(DomainStart=0, DomainEnd=Slider(7.52, range=0..10))
bounds_2 = Bounds(Numbers=pull_point.Distance)
construct_domain_2 = ConstructDomain(DomainStart=0, DomainEnd=Slider(1.34, range=0..10))
remap_numbers = RemapNumbers(Value=pull_point.Distance, Source=bounds_2, Target=construct_domain)  # -> Mapped, Clipped
bounds_3 = Bounds(Numbers=pull_point_2.Distance)
remap_numbers_2 = RemapNumbers(Value=pull_point_2.Distance, Source=bounds_3, Target=construct_domain_2)  # -> Mapped, Clipped
graph_mapper_2 = GraphMapper(
    remap_numbers.Mapped,
    x0=0,
    x1=1,
    y0=0,
    y1=1,
    container_name="Sine",
    Equation_px=[0, 0.5889980793],
    Equation_py=[0, 0.6019605398])
equality = Equality(FirstNumber=number, SecondNumber="1")  # -> Equality, Inequality
equality_2 = Equality(FirstNumber=number, SecondNumber="2")  # -> Equality, Inequality
equality_3 = Equality(FirstNumber=number, SecondNumber="0")  # -> Equality, Inequality
number_slider_2 = Slider(88, range=0..100)
graph_mapper_3 = GraphMapper(remap_numbers_2.Mapped, x0=0, x1=1, y0=0, y1=1, container_name="Sine", Equation_px=[0, 0.5728883743], Equation_py=[0, 1])
construct_domain_3 = ConstructDomain(DomainStart=0, DomainEnd=Slider(10, range=0..10))
number_slider_3 = Slider(20, range=0..100)
bounds_4 = Bounds(Numbers=graph_mapper_2)
dispatch = Dispatch(List=cluster.P, DispatchPattern=equality.Equality)  # -> ListA, ListB
move_2 = Move(Geometry=cluster.P_2, Motion=expr("-x", unit_z))  # -> Geometry, Transform
dispatch_2 = Dispatch(List=surface_from_points, DispatchPattern=equality_3.Equality)  # -> ListA, ListB
dispatch_3 = Dispatch(List=surface_from_points, DispatchPattern=equality_2.Equality)  # -> ListA, ListB
construct_domain_4 = ConstructDomain(DomainStart=0, DomainEnd=Slider(36.89, range=0..100))
bounds_5 = Bounds(Numbers=graph_mapper_3)
surface_from_points_2 = SurfaceFromPoints(Points=flatten(move_2.Geometry), UCount=expr("x+1", uv_count), Interpolate=False)
remap_numbers_3 = RemapNumbers(Value=graph_mapper_2, Source=bounds_4, Target=construct_domain_3)  # -> Mapped, Clipped
plane_surface = PlaneSurface(Plane=PlaneXY(0, 0, 0), XSize=number_slider_2, YSize=number_slider_2)
panel_3 = Panel(equality_3.Equality)
brep_wireframe = BrepWireframe(Brep=dispatch.ListA, Density=-1)  # -> graft(Wireframe)
unit_z_2 = UnitZ(Factor=remap_numbers_3.Mapped)
divide_surface_2 = DivideSurface(Surface=plane_surface, UCount=number_slider_3, VCount=number_slider_3)  # -> Points, Normals, Parameters
remap_numbers_4 = RemapNumbers(Value=graph_mapper_3, Source=bounds_5, Target=construct_domain_4)  # -> Mapped, Clipped
dispatch_4 = Dispatch(List=surface_from_points_2, DispatchPattern=equality_2.Equality)  # -> ListA, ListB
dispatch_5 = Dispatch(List=surface_from_points, DispatchPattern=equality.Equality)  # -> ListA, ListB
addition = Addition(A=number_slider, B="1")
move_3 = Move(Geometry=divide_surface.Points, Motion=unit_z_2)  # -> Geometry, Transform
brep_wireframe_2 = BrepWireframe(Brep=dispatch_3.ListA, Density=-1)  # -> graft(Wireframe)
brep_wireframe_3 = BrepWireframe(Brep=dispatch_5.ListA, Density=-1)  # -> graft(Wireframe)
brep_wireframe_4 = BrepWireframe(Brep=dispatch_4.ListA, Density=-1)  # -> graft(Wireframe)
unit_z_3 = UnitZ(Factor=remap_numbers_4.Mapped)
unit_z_4 = UnitZ(Factor="2000")
unit_z_5 = UnitZ(Factor=expr("-x", extrusion))
loft = Loft(
    Curves=[brep_wireframe_2, brep_wireframe_4],
    Options={Adjust=False, Closed=False, LoftEnds=0, LoftSimp=0, LoftType=3, Rebuild=10, Refit=0.01})
move_4 = Move(Geometry=trim_curve, Motion=expr("-x/2", unit_z_4))  # -> Geometry, Transform
move_5 = Move(Geometry=move_3.Geometry, Motion=unit_z_3)  # -> Geometry, Transform
loft_2 = Loft(
    Curves=[brep_wireframe, brep_wireframe_3],
    Options={Adjust=False, Closed=False, LoftEnds=0, LoftSimp=0, LoftType=3, Rebuild=10, Refit=0.01})
brep_join = BrepJoin(Breps=flatten([loft, dispatch_3.ListA, dispatch_4.ListA]))  # -> Breps, Closed
extrude = Extrude(Base=move_4.Geometry, Direction=unit_z_4)
brep_join_2 = BrepJoin(Breps=flatten([loft_2, dispatch_5.ListA, dispatch.ListA]))  # -> Breps, Closed
dispatch_6 = Dispatch(List=extrude, DispatchPattern=trim_da_boring_square)  # -> ListA, ListB
surface_from_points_3 = SurfaceFromPoints(Points=move_5.Geometry, UCount=addition, Interpolate=False)
extrude_2 = Extrude(Base=surface_from_points_3, Direction=unit_z_5)
brep = Brep([extrude_2, brep_join_2.Breps, brep_join.Breps])
dispatch_7 = Dispatch(List=brep, DispatchPattern=trim_da_boring_square)  # -> ListA, ListB
custom_preview = CustomPreview(
    Geometry=[extrude_2, brep_join_2.Breps, brep_join.Breps],
    Shader={diffuse=RGB(255, 105, 180), emission=RGB(76, 32, 54), shine=0.5, specular=RGB(255, 255, 255), transparency=0.3})
solid_intersection = SolidIntersection(BrepsA=dispatch_7.ListA, BrepsB=dispatch_6.ListA)
number_slider_4 = Slider(100, range=0..100)
sphere = Sphere(Base=PlaneXY(0, 0, 0), Radius=number_slider_4)
cone = Cone(Base=PlaneXY(0, 0, 0), Radius=number_slider_4, Length=Slider(53, range=-11..60))  # -> Cone, Tip
brep_2 = Brep([dispatch_7.ListB, solid_intersection])
bounding_box = BoundingBox(Content=brep_2, Plane=PlaneXY(0, 0, 0))  # -> Box, Box_2
box_properties = BoxProperties(Box=bounding_box.Box)  # -> Center, Diagonal, Area, Volume, Degeneracy
deconstruct_vector = DeconstructVector(Vector=box_properties.Diagonal)  # -> XComponent, YComponent, ZComponent
custom_preview_2 = CustomPreview(
    Geometry=brep_2,
    Shader={diffuse=RGB(255, 105, 180), emission=RGB(76, 32, 54), shine=0.5, specular=RGB(255, 255, 255), transparency=0})
# you can also apply a graph filter. try other types of graph:
# 
# RIGHT CLICK
# then
# "GRAPH TYPES"
# to change input image:
# 
# RIGHT CLICK
# then
# "IMAGE..."
panel_4 = Panel("IMAGE INPUT")

# ----
# CLICK THE BUTTON BELOW TO UPDATE RIBS
# WARNING: THIS MAY TAKE A WHILE DEPENDING ON THE NUMBER OF RIBS
# NUMBER OF RIBS (Y)
# NUMBER OF RIBS (X)
data_dam = DataDam(DataA=brep_2, BufferDelay=10000000, BufferMode=0)
ribs_y = Slider(20, range=1..20)
ribs_x = Slider(10, range=1..20)

brep_3 = Brep(data_dam)
# This work is licensed under a Creative Commons Attribution-NonCommercial-NoDerivs 3.0 Unported License
# http://creativecommons.org/licenses/by-nc-nd/3.0/
# Antonio Turiello Design
# http://antonioturiello.blogspot.com/
panel_5 = Panel("Digital Fabrication - Ribs")
bounding_box_2 = BoundingBox(Content=brep_3, Plane=PlaneXY(0, 0, 0))  # -> Box, Box_2
box_corners = BoxCorners(Box=bounding_box_2.Box)  # -> CornerA, CornerB, CornerC, CornerD, CornerE, CornerF, CornerG, CornerH
variable_expression = VariableExpression(NA=ribs_y, Expression="NA+1")
variable_expression_2 = VariableExpression(NB=ribs_x, Expression="NB+1")
line = Line(StartPoint=box_corners.CornerA, EndPoint=box_corners.CornerB)
line_2 = Line(StartPoint=box_corners.CornerB, EndPoint=box_corners.CornerC)
distance = Distance(PointA=box_corners.CornerD, PointB=box_corners.CornerH)
panel_6 = Panel(line_2)
panel_7 = Panel(line)
perp_frames = PerpFrames(Curve=line_2, Count=variable_expression, Align=True)  # -> Frames, Parameters
perp_frames_2 = PerpFrames(Curve=line, Count=variable_expression_2, Align=True)  # -> Frames, Parameters
shift_list = ShiftList(List=perp_frames.Frames, Shift=1, Wrap=False)
shift_list_2 = ShiftList(List=perp_frames_2.Frames, Shift=1, Wrap=False)
panel_8 = Panel(perp_frames.Frames)
panel_9 = Panel("OVERALL Z DIMENSION")
shift_list_3 = ShiftList(List=shift_list, Shift=-1, Wrap=False)
list_item = ListItem(List=shift_list_3, Index=1, Wrap=True)
list_item_2 = ListItem(List=shift_list_3, Index=0, Wrap=True)
distance_2 = Distance(PointA=list_item_2, PointB=list_item)
shift_list_4 = ShiftList(List=shift_list_2, Shift=-1, Wrap=False)
list_item_3 = ListItem(List=shift_list_4, Index=1, Wrap=True)
list_item_4 = ListItem(List=shift_list_4, Index=0, Wrap=True)
distance_3 = Distance(PointA=list_item_4, PointB=list_item_3)
brep_plane = BrepPlane(Brep=brep_3, Plane=shift_list_4)  # -> Curves, Points
brep_plane_2 = BrepPlane(Brep=brep_3, Plane=shift_list_3)  # -> Curves, Points
clean_tree = CleanTree(Data=brep_plane_2.Curves, CleanInvalid=True, CleanEmpty=True)
clean_tree_2 = CleanTree(Data=brep_plane.Curves, CleanInvalid=True, CleanEmpty=True)
panel_10 = Panel(distance)
join_curves = JoinCurves(Curves=clean_tree, Preserve=False)
join_curves_2 = JoinCurves(Curves=clean_tree_2, Preserve=False)
length = Length(Curve=join_curves_2)
length_2 = Length(Curve=join_curves)
lmin = Slider(10, range=0..10)
l_lmin = VariableExpression(L=length_2, Lmin=lmin, Expression="L>Lmin")
l_lmin_2 = VariableExpression(L=length, Lmin=lmin, Expression="L>Lmin")
cull_pattern = CullPattern(List=join_curves, CullPattern=l_lmin)
cull_pattern_2 = CullPattern(List=join_curves_2, CullPattern=l_lmin_2)
panel_11 = Panel("RIB SPACING (X)")
panel_12 = Panel("RIB SPACING (Y)")
clean_tree_3 = CleanTree(Data=cull_pattern, CleanInvalid=True, CleanEmpty=True)
clean_tree_4 = CleanTree(Data=cull_pattern_2, CleanInvalid=True, CleanEmpty=True)
planar = PlanarSrf(Edges=clean_tree_3)
planar_2 = PlanarSrf(Edges=clean_tree_4)
panel_13 = Panel(distance_2)
panel_14 = Panel(distance_3)
flatten_tree = FlattenTree(Data=planar_2, Path="{0}")
brep_brep = BrepBrep(BrepA=planar, BrepB=flatten_tree, DataComparison="cross_reference")  # -> Curves, Points
clean_tree_5 = CleanTree(Data=brep_brep.Curves, CleanInvalid=True, CleanEmpty=True)
# MATERIAL THICKNESS:
# 1.15mm
# (white matboard)
af = Slider(1.15, range=0.1..4)
length_3 = Length(Curve=clean_tree_5)
_2 = Integer(2)
division = Division(A=length_3, B=_2)
unit_z_6 = UnitZ(Factor=division)
reverse = Reverse(Vector=unit_z_6)
move_6 = Move(Geometry=clean_tree_5, Motion=unit_z_6)  # -> Geometry, Transform
move_7 = Move(Geometry=clean_tree_5, Motion=reverse)  # -> Geometry, Transform
unit_y = UnitY(Factor=af)
division_2 = Division(A=af, B=_2)
unit_y_2 = UnitY(Factor=division_2)
multiplication = Multiplication(A=af, B=_2)
reverse_2 = Reverse(Vector=unit_y)
reverse_3 = Reverse(Vector=unit_y_2)
move_8 = Move(Geometry=move_6.Geometry, Motion=reverse_2)  # -> Geometry, Transform
move_9 = Move(Geometry=move_7.Geometry, Motion=reverse_3)  # -> Geometry, Transform
unit_y_3 = UnitY(Factor=multiplication)
unit_x = UnitX(Factor=af)
unit_x_2 = UnitX(Factor=division_2)
unit_y_4 = UnitY(Factor=af)
unit_x_3 = UnitX(Factor=multiplication)
unit_x_4 = UnitX(Factor=af)
extrude_3 = Extrude(Base=move_8.Geometry, Direction=unit_y_3)
extrude_4 = Extrude(Base=move_9.Geometry, Direction=unit_y_4)
reverse_4 = Reverse(Vector=unit_x_2)
unit_y_5 = UnitY(Factor=division_2)
unit_x_5 = UnitX(Factor=division_2)
reverse_5 = Reverse(Vector=unit_x_4)
move_10 = Move(Geometry=extrude_4, Motion=reverse_5)  # -> Geometry, Transform
move_11 = Move(Geometry=extrude_3, Motion=reverse_4)  # -> Geometry, Transform
reverse_6 = Reverse(Vector=unit_x_5)
reverse_7 = Reverse(Vector=unit_y_5)
move_12 = Move(Geometry=planar, Motion=reverse_7)  # -> Geometry, Transform
move_13 = Move(Geometry=planar_2, Motion=reverse_6)  # -> Geometry, Transform
extrude_5 = Extrude(Base=move_10.Geometry, Direction=unit_x_3)
extrude_6 = Extrude(Base=move_11.Geometry, Direction=unit_x)
unit_y_6 = UnitY(Factor=af)
unit_x_6 = UnitX(Factor=af)
extrude_7 = Extrude(Base=move_12.Geometry, Direction=unit_y_6)
extrude_8 = Extrude(Base=move_13.Geometry, Direction=unit_x_6)
flatten_tree_2 = FlattenTree(Data=extrude_5, Path="{0}")
flatten_tree_3 = FlattenTree(Data=extrude_6, Path="{0}")
solid_difference = SolidDifference(BrepsA=extrude_8, BrepsB=flatten_tree_2)
graft_tree = GraftTree(Data=shift_list_3, Strip=False)
graft_tree_2 = GraftTree(Data=shift_list_4, Strip=False)
solid_difference_2 = SolidDifference(BrepsA=extrude_7, BrepsB=flatten_tree_3)
brep_plane_3 = BrepPlane(Brep=solid_difference_2, Plane=graft_tree)  # -> Curves, Points
brep_plane_4 = BrepPlane(Brep=solid_difference, Plane=graft_tree_2)  # -> Curves, Points
clean_tree_6 = CleanTree(Data=brep_plane_3.Curves, CleanInvalid=True, CleanEmpty=True)
clean_tree_7 = CleanTree(Data=brep_plane_4.Curves, CleanInvalid=True, CleanEmpty=True)
join_curves_3 = JoinCurves(Curves=clean_tree_7, Preserve=False)
join_curves_4 = JoinCurves(Curves=clean_tree_6, Preserve=False)
length_4 = Length(Curve=join_curves_4)
length_5 = Length(Curve=join_curves_3)
lmin_2 = Slider(10, range=0..10)
l_lmin_3 = VariableExpression(L=length_4, Lmin=lmin_2, Expression="L>Lmin")
l_lmin_4 = VariableExpression(L=length_5, Lmin=lmin_2, Expression="L>Lmin")
cull_pattern_3 = CullPattern(List=join_curves_4, CullPattern=l_lmin_3)
cull_pattern_4 = CullPattern(List=join_curves_3, CullPattern=l_lmin_4)
clean_tree_8 = CleanTree(Data=cull_pattern_3, CleanInvalid=True, CleanEmpty=True)
clean_tree_9 = CleanTree(Data=cull_pattern_4, CleanInvalid=True, CleanEmpty=True)
flatten_tree_4 = FlattenTree(Data=clean_tree_8, Path="{0}")
flatten_tree_5 = FlattenTree(Data=clean_tree_9, Path="{0}")
planar_3 = PlanarSrf(Edges=flatten_tree_4)
planar_4 = PlanarSrf(Edges=flatten_tree_5)
area = Area(Geometry=planar_3)  # -> Area, Centroid
area_2 = Area(Geometry=planar_4)  # -> Area, Centroid
orient = Orient(Geometry=flatten_tree_4, Source=area.Centroid, Target=Plane(origin=(0, 0, 0), x=(0, -1, 0), y=(0, 0, -1)))  # -> Geometry, Transform
orient_2 = Orient(Geometry=flatten_tree_5, Source=area_2.Centroid, Target=Plane(origin=(0, 0, 0), x=(0, 0, 1), y=(1, 0, 0)))  # -> Geometry, Transform
pi = Pi(Factor=0.5)
move_14 = Move(Geometry=[solid_difference_2, solid_difference], Motion="{0.0,550.0,0.0}")  # -> Geometry, Transform
move_15 = Move(Geometry=area.Centroid, Motion="{0.0,550.0,0.0}")  # -> Geometry, Transform
move_16 = Move(Geometry=area_2.Centroid, Motion="{0.0,550.0,0.0}")  # -> Geometry, Transform
rotate = Rotate(Geometry=orient.Geometry, Angle=pi, Plane=PlaneXY(0, 0, 0))  # -> Geometry, Transform
prepare_cutsheets = PREPARECUTSHEETS(L=move_15.Geometry, L_2=move_16.Geometry, crv_2=rotate.Geometry, crv=orient_2.Geometry)  # -> G, C_3, C_4, number_slider_4, r, crv_7, crv_13, crv_12, r_2, crv_9
C = ColourSwatch(SwatchColor=RGB(255, 0, 0))
C_2 = ColourSwatch(SwatchColor=RGB(0, 255, 77))
text_tag_3d = TextTag3D(
    Location=move_15.Geometry,
    Text=prepare_cutsheets.r,
    Size=prepare_cutsheets.number_slider_4,
    Colour=prepare_cutsheets.C_4,
    Justification=7)
text_tag_3d_2 = TextTag3D(
    Location=move_16.Geometry,
    Text=prepare_cutsheets.r_2,
    Size=prepare_cutsheets.number_slider_4,
    Colour=prepare_cutsheets.C_3,
    Justification=7)
custom_preview_3 = CustomPreview(
    Geometry=move_14.Geometry,
    Shader={diffuse=RGB(255, 105, 180), emission=RGB(76, 32, 54), shine=0.5, specular=RGB(255, 255, 255), transparency=0.7})
custom_preview_4 = CustomPreview(Geometry=[prepare_cutsheets.crv_7, prepare_cutsheets.crv_13], Shader=C)
custom_preview_5 = CustomPreview(Geometry=[prepare_cutsheets.crv_12, prepare_cutsheets.crv_9], Shader=C_2)

# ----
# to bake:
# 
# 1) RIGHT CLICK
# 2) "BAKE..."
# 3) SELECT THE LAYER WITH THE SAME NAME
# 4) "OK"
panel_15 = Panel("FINAL OUTPUT")
laser_etch = Curve(flatten([prepare_cutsheets.crv_13, prepare_cutsheets.crv_12]))
stock = Curve(prepare_cutsheets.G)
laser_cut = Curve([prepare_cutsheets.crv_7, prepare_cutsheets.crv_9])

# ==== cluster PREPARECUTSHEETS

# ---- group: STOCK / SHEET DIMENSIONS
number_slider = Slider(30, range=0..100)
number_slider_2 = Slider(20, range=0..100)

# ---- group: STOCK
sheet_margin = Slider(16, range=0..200)
number_slider_3 = Slider(25.4, range=0..100)  # "IN->MM"

# ----
crv = ClusterInput()
crv_2 = ClusterInput()

# ---- group: STOCK
multiplication = Multiplication(A=number_slider, B=number_slider_3)
multiplication_2 = Multiplication(A=number_slider_2, B=number_slider_3)

subtraction = Subtraction(A=multiplication, B=sheet_margin)
rectangle = Rectangle(Plane=PlaneXY(0, 0, 0), XSize=multiplication, YSize=multiplication_2, Radius=0)  # -> Rectangle, Length

# ---- group: SHEET PACKING [SIMPLE]
crv_3 = Curve(crv)
crv_4 = Curve(crv_2)
_1_pass_binpacker = _1PASSBINPACKER(sheet_x_dimension=subtraction, curves_for_pack=crv_4)
_1_pass_binpacker_2 = _1PASSBINPACKER(sheet_x_dimension=subtraction, curves_for_pack=crv_3)
crv_5 = Curve(_1_pass_binpacker)
crv_6 = Curve(_1_pass_binpacker_2)

# ----
vec = VectorXYZ(XComponent=expr("-x", sheet_margin), YComponent=expr("-x", sheet_margin), ZComponent=0)  # -> Vector, Length
vec_2 = VectorXYZ(XComponent=expr("-x", Slider(1000, range=0..1000)), YComponent=0, ZComponent=0)  # -> Vector, Length
move = Move(Geometry=rectangle.Rectangle, Motion=vec.Vector)  # -> Geometry, Transform
crv_7 = ClusterOutput(crv_5)

# ---- group: MOVE B CURVES UP
bbox = BoundingBox(Content=crv_5, Plane=PlaneXY(0, 0, 0), UnionBox=True)  # -> Box, Box_2
debox = DeconstructBox(Box=bbox.Box)  # -> Plane, X, Y, Z
dedomain = DeconstructDomain(Domain=debox.Y)  # -> Start, End
vec_3 = VectorXYZ(XComponent=0, YComponent=dedomain.End, ZComponent=0)  # -> Vector, Length
move_2 = Move(Geometry=crv_6, Motion=vec_3.Vector)  # -> Geometry, Transform

# ----
G = ClusterOutput(move.Geometry)
move_3 = Move(Geometry=move.Geometry, Motion=vec_2.Vector)  # -> Geometry, Transform
crv_8 = Curve(move_2.Geometry)
lng = ListLength(List=crv_5)
crv_9 = ClusterOutput(crv_8)
lng_2 = ListLength(List=crv_8)
S = Slider(2.9, range=1..15)
C = ColourSwatch(SwatchColor=RGB(0, 255, 77))
C_2 = ColourSwatch(SwatchColor=RGB(255, 0, 0))
series = Series(Start=0, Step=1, Count=lng)
series_2 = Series(Start=0, Step=1, Count=lng_2)
C_3 = ClusterOutput(C)
a_x = VariableExpression(x=series, Expression="Format(\"Y{0}\",x)")
C_4 = ClusterOutput(C_2)
number_slider_4 = ClusterOutput(Slider(3, range=0..100))
b_x = VariableExpression(x=series_2, Expression="Format(\"X{0}\",x)")
L = ClusterInput()
L_2 = ClusterInput()
r = ClusterOutput(a_x)
r_2 = ClusterOutput(b_x)

# ---- group: TEXT POSITIONING
put_text_inside_crv = PUTTEXTINSIDECRV(T=b_x, S=S, crv=crv_8)  # -> G, A
put_text_inside_crv_2 = PUTTEXTINSIDECRV(T=a_x, S=S, crv=crv_5)  # -> G, A

# ----
tag = TextTag(Location=L, Text=a_x, Colour=C)
tag_2 = TextTag(Location=L_2, Text=b_x, Colour=C)
error_log = Panel(put_text_inside_crv.A)
error_log_2 = Panel(put_text_inside_crv_2.A)
crv_10 = Curve(put_text_inside_crv.G)
crv_11 = Curve(put_text_inside_crv_2.G)
crv_12 = ClusterOutput(crv_10)
crv_13 = ClusterOutput(crv_11)

# ==== cluster Cluster
md_slider = MDSlider(
    SliderMode=0,
    slider_value=Point(0.3125, 0.5320121951, 0.5),
    x_domain=Domain(-2000, 2000),
    y_domain=Domain(-2000, 2000),
    z_domain=Domain(0, 1))
panel = Panel("-1000")
xy = XYPlane(Origin=Point(0, 0, 0))
xz = XZPlane(Origin=Point(0, 0, 0))
move = Move(Geometry=xy, Motion=md_slider)  # -> Geometry, Transform
X = ClusterInput()
Y = ClusterInput()
planesrf = PlaneSurface(Plane=move.Geometry, XSize=X, YSize=Y)
P = ClusterOutput(planesrf)
U = ClusterInput()
V = ClusterInput()
sdivide = DivideSurface(Surface=planesrf, UCount=U, VCount=V)  # -> Points, Normals, Parameters
P_2 = ClusterOutput(sdivide.Points)
pdecon = Deconstruct(Point=sdivide.Points)  # -> XComponent, YComponent, ZComponent
bnd = Bounds(Numbers=flatten(pdecon.XComponent))
bnd_2 = Bounds(Numbers=flatten(pdecon.YComponent))
remap = RemapNumbers(Value=pdecon.YComponent, Source=bnd_2, Target="0 to 1")  # -> Mapped, Clipped
remap_2 = RemapNumbers(Value=pdecon.XComponent, Source=bnd, Target="0 to 1")  # -> Mapped, Clipped
pt = ConstructPoint(XCoordinate=remap_2.Mapped, YCoordinate=remap.Mapped, ZCoordinate=0)
pt_2 = ClusterOutput(pt)

# ==== cluster _1PASSBINPACKER
curves_for_pack = ClusterInput()
curves_for_pack_2 = Curve(curves_for_pack)
bbox = BoundingBox(Content=curves_for_pack_2, Plane=PlaneXY(0, 0, 0), UnionBox=False)  # -> Box, Box_2
debox = DeconstructBox(Box=bbox.Box)  # -> Plane, X, Y, Z
dedomain = DeconstructDomain(Domain=debox.X)  # -> Start, End
dedomain_2 = DeconstructDomain(Domain=debox.Y)  # -> Start, End
pt = ConstructPoint(XCoordinate=dedomain.Start, YCoordinate=dedomain_2.Start, ZCoordinate=0)
pt_2 = ConstructPoint(XCoordinate=0, YCoordinate=0, ZCoordinate=0)
vec2pt = Vector2Pt(PointA=pt, PointB=pt_2, Unitize=False)  # -> Vector, Length
move = Move(Geometry=curves_for_pack_2, Motion=vec2pt.Vector)  # -> Geometry, Transform
bbox_2 = BoundingBox(Content=move.Geometry, Plane=PlaneXY(0, 0, 0), UnionBox=False)  # -> Box, Box_2
debox_2 = DeconstructBox(Box=bbox_2.Box)  # -> Plane, X, Y, Z
dedomain_3 = DeconstructDomain(Domain=debox_2.X)  # -> Start, End
dedomain_4 = DeconstructDomain(Domain=debox_2.Y)  # -> Start, End
subtraction = Subtraction(A=dedomain_4.End, B=dedomain_4.Start)
subtraction_2 = Subtraction(A=dedomain_3.End, B=dedomain_3.Start)
sheet_x_dimension = ClusterInput()
dom = ConstructDomain(DomainStart=0, DomainEnd=subtraction)
dom_2 = ConstructDomain(DomainStart=0, DomainEnd=subtraction_2)
rectangle = Rectangle(Plane=PlaneXY(0, 0, 0), XSize=dom_2, YSize=dom, Radius=0)  # -> Rectangle, Length
sheet_x_dimension_2 = Number(sheet_x_dimension)
ins = InsertItems(List=subtraction_2, Item=0, Indices=0, Wrap=True)
drec = DeconstuctRectangle(Rectangle=rectangle.Rectangle)  # -> BasePlane, XInterval, YInterval
cull_i = CullIndex(List=reverse(ins), Indices=0, Wrap=True)  # -> reverse(List)
dedomain_5 = DeconstructDomain(Domain=drec.XInterval)  # -> Start, End
dedomain_6 = DeconstructDomain(Domain=drec.YInterval)  # -> Start, End
subtraction_3 = Subtraction(A=dedomain_5.End, B=dedomain_5.Start)
subtraction_4 = Subtraction(A=dedomain_6.End, B=dedomain_6.Start)
ma = MassAddition(Input=cull_i)  # -> Result, PartialResults
bnd = Bounds(Numbers=subtraction_4)
bnd_2 = Bounds(Numbers=subtraction_3)
dedomain_7 = DeconstructDomain(Domain=bnd)  # -> Start, End
dedomain_8 = DeconstructDomain(Domain=bnd_2)  # -> Start, End
lng = ListLength(List=move.Geometry)
division = Division(A=dedomain_8.End, B=Slider(1.1, range=0..10))
subtraction_5 = Subtraction(A=sheet_x_dimension_2, B=division)
division_2 = Division(A=ma.PartialResults, B=subtraction_5)
mod = Modulus(A=ma.PartialResults, B=subtraction_5)
reldif = RelativeDifferences(Values=mod)
smaller = SmallerThan(FirstNumber=reldif, SecondNumber=0)  # -> SmallerThan, OrEqualTo
series = Series(Start=0, Step=1, Count=lng)
round = Round(Number=division_2)  # -> Nearest, Floor, Ceiling
cull = CullPattern(List=series, CullPattern=smaller.SmallerThan)
multiplication = Multiplication(A=round.Floor, B=dedomain_7.End)
merge = Merge(Data1=simplify(flatten(0)), Data2=simplify(flatten(cull)), Data3=simplify(flatten(lng)))
shift = ShiftList(List=merge, Shift=1, Wrap=False)
dom_3 = ConstructDomain(DomainStart=merge, DomainEnd=shift)
item = ListItem(List=mod, Index=cull, Wrap=True)
cull_i_2 = CullIndex(List=reverse(dom_3), Indices=0, Wrap=True)  # -> reverse(List)
merge_2 = Merge(Data1=simplify(flatten(0)), Data2=simplify(flatten(item)))
inc = Includes(Value=graft(series), Domain=cull_i_2)  # -> Includes, Deviation
panel = Panel(merge_2)
cull_2 = CullPattern(List=merge_2, CullPattern=inc.Includes)
item_2 = ListItem(List=reverse(cull_2), Index=0, Wrap=True)
replace = ReplaceItems(List=series, Item=flatten(item_2), Indices=series, Wrap=False)
subtraction_6 = Subtraction(A=mod, B=replace)
panel_2 = Panel(subtraction_6)
vec = VectorXYZ(XComponent=subtraction_6, YComponent=multiplication, ZComponent=0)  # -> Vector, Length
move_2 = Move(Geometry=rectangle.Rectangle, Motion=vec.Vector)  # -> Geometry, Transform
pcen = PolygonCenter(Polyline=rectangle.Rectangle)  # -> CenterV, CenterE, CenterA
pcen_2 = PolygonCenter(Polyline=move_2.Geometry)  # -> CenterV, CenterE, CenterA
vec2pt_2 = Vector2Pt(PointA=pcen.CenterV, PointB=pcen_2.CenterV, Unitize=False)  # -> Vector, Length
move_3 = Move(Geometry=move.Geometry, Motion=vec2pt_2.Vector)  # -> Geometry, Transform
G = ClusterOutput(move_3.Geometry)

# ==== cluster PUTTEXTINSIDECRV
crv = ClusterInput()
number_slider = Slider(50, range=0..100)
crv_2 = Curve(simplify(crv))
divide = DivideCurve(Curve=crv_2, Count=number_slider, Kinks=False)  # -> Points, Tangents, Parameters
Z = UnitZ(Factor=Slider(0.1, range=0.01..0.1))
pi = Pi(Factor=0.5)
vrot = Rotate(Vector=divide.Tangents, Axis=Z, Angle=pi)
move = Move(Geometry=divide.Points, Motion=vrot)  # -> Geometry, Transform
pt = ConstructPoint(XCoordinate=0, YCoordinate=0, ZCoordinate=0)
ln = Line(StartPoint=divide.Points, EndPoint=move.Geometry)
T = ClusterInput()
S = ClusterInput()
pt_2 = Point(graft(divide.Points))
clx = CurveLine(Curve=graft(crv_2), Line=ln)  # -> Points, Params, Count
bbtext = BBText(Location=pt, Text=T, Size=S, Bold=False, HorizontalAlignment=0, VerticalAlignment=0)  # -> simplify(Curves)
dist = Distance(PointA=pt_2, PointB=clx.Points)
bbox = BoundingBox(Content=bbtext, Plane=PlaneXY(0, 0, 0), UnionBox=True)  # -> Box, Box_2
sort = SortList(Keys=dist, ValuesA=clx.Points)  # -> Keys, ValuesA
debox = DeconstructBox(Box=bbox.Box)  # -> Plane, X, Y, Z
cull_i = CullIndex(List=sort.ValuesA, Indices=0, Wrap=True)
rectangle = Rectangle(Plane=debox.Plane, XSize=debox.X, YSize=debox.Y, Radius=0)  # -> Rectangle, Length
item = ListItem(List=cull_i, Index=0, Wrap=True)  # -> Item, Item1
ln_2 = Line(StartPoint=item.Item1, EndPoint=pt_2)  # -> simplify(Line)
curvepoint = PointOnCurve(ln_2, parameter=0.5)
path_mapper = PathMapper(curvepoint, source="{A;B}", target="{A}")
vec2pt = Vector2Pt(PointA=debox.Plane, PointB=path_mapper, Unitize=False)  # -> Vector, Length
crv_3 = Curve(simplify(graft(crv_2)))
move_2 = Move(Geometry=rectangle.Rectangle, Motion=vec2pt.Vector)  # -> Geometry, Transform
dup = DuplicateData(Data=crv_3, Number=number_slider, Order=True)  # -> simplify(graft(Data))
divide_2 = DivideCurve(Curve=move_2.Geometry, Count=10, Kinks=True)  # -> Points, Tangents, Parameters
incurve = PointInCurve(Point=divide_2.Points, Curve=dup)  # -> Relationship, Point
_2 = B(2)
subtraction = Subtraction(A=incurve.Relationship, B=_2)
ma = MassAddition(Input=subtraction)  # -> Result, PartialResults
larger = LargerThan(FirstNumber=ma.Result, SecondNumber=0)  # -> LargerThan, OrEqualTo
cull = CullPattern(List=graft(move_2.Geometry), CullPattern=larger.OrEqualTo)
path_mapper_2 = PathMapper(cull, source="{A;B}", target="{A}")
item_2 = ListItem(List=path_mapper_2, Index=0, Wrap=True)
pcen = PolygonCenter(Polyline=item_2)  # -> CenterV, CenterE, CenterA
flatten = FlattenTree(Tree=item_2, Path="{0}")
vec2pt_2 = Vector2Pt(PointA=pt, PointB=pcen.CenterV, Unitize=False)  # -> Vector, Length
clean = CleanTree(Tree=flatten(flatten), CleanInvalid=True, CleanEmpty=True)
move_3 = Move(Geometry=bbtext, Motion=vec2pt_2.Vector)  # -> Geometry, Transform
lng = ListLength(List=flatten)
lng_2 = ListLength(List=clean)
error_msg = Panel("""FONT SIZE TOO BIG
COULD NOT SOLVE FOR INTERIOR LOCATION FOR TEXT""")
G = ClusterOutput(move_3.Geometry)
smaller = SmallerThan(FirstNumber=lng_2, SecondNumber=lng)  # -> SmallerThan, OrEqualTo
dispatch = Dispatch(List=error_msg, DispatchPattern=smaller.SmallerThan)  # -> ListA, ListB
A = ClusterOutput(dispatch.ListA)
