# Grasshopper definition swirl.gh (Grasshopper 1.0.7)

number_slider = Slider(33, range=0..50)
radius = Slider(0, range=0..100)
segments = Slider(7, range=0..10)
radius_2 = Slider(21, range=0..100)
segments_2 = Slider(3, range=0..10)
number_slider_2 = Slider(25, range=0..100)
range = Range(Domain=number_slider, Steps=expr("x-1", number_slider))
bounds = Bounds(Numbers=range)
remap_numbers = RemapNumbers(Value=range, Source=bounds, Target=Domain(0, 1))  # -> Mapped, Clipped
multiplication = Multiplication(A=number_slider_2, B="-0.5")
series = Series(Start=radius, Step=segments, Count=number_slider)
polygon = Polygon(Plane=PlaneXY(0, 0, 0), Radius=radius_2, Segments=segments_2, FilletRadius=Slider(3, range=0..10))  # -> Polygon, Length
rectangle = Rectangle(Plane=PlaneXY(0, 0, 0), XSize=number_slider_2, YSize=number_slider_2, Radius=0)  # -> Rectangle, Length
unit_x = UnitX(Factor=multiplication)
move = Move(Geometry=rectangle.Rectangle, Motion=unit_x)  # -> Geometry, Transform
unit_y = UnitY(Factor=multiplication)
graph_mapper = GraphMapper(
    remap_numbers.Mapped,
    x0=0,
    x1=1,
    y0=0,
    y1=1,
    amplitude=0.2761336565,
    container_name="Perlin",
    decay=0.5227156878,
    frequency=0.2723510265,
    x_offset=0.3471000791,
    y_offset=0.5718905926)
graph_mapper_2 = GraphMapper(
    remap_numbers.Mapped,
    x0=0,
    x1=1,
    y0=0,
    y1=1,
    container_name="Sine",
    Equation_px=[0.6530580521, 0.05180491507],
    Equation_py=[0.01445651054, 0.6285700798])
graph_mapper_3 = GraphMapper(remap_numbers.Mapped, x0=0, x1=1, y0=0, y1=1, container_name="Bezier", cpx=[0, 1, 0.4228573143, 1], cpy=[0, 1, 0, 0])
unit_z = UnitZ(Factor=series)
move_2 = Move(Geometry=rectangle.Rectangle, Motion=unit_x)  # -> Geometry, Transform
move_3 = Move(Geometry=polygon.Polygon, Motion=unit_z)  # -> Geometry, Transform
unit_z_2 = UnitZ(Factor=Slider(125, range=0..1000))
panel = Panel(graph_mapper)
move_4 = Move(Geometry=move_2.Geometry, Motion=unit_y)  # -> Geometry, Transform
control_points = ControlPoints(Curve=move_3.Geometry)  # -> Points, Weights, Knots
extrude = Extrude(Base=move_4.Geometry, Direction=unit_z_2)
point = Point(Point(0, 0, 0))
point_2 = Point(Point(0, 0, 130))
bounds_2 = Bounds(Numbers=panel)
construct_domain = ConstructDomain(DomainStart=Slider(1.8, range=0..10), DomainEnd=Slider(4.5, range=0..10))
average = Average(Input=control_points.Points)
line = Line(StartPoint=point, EndPoint=point_2)
cap_holes = CapHoles(Brep=extrude)
remap_numbers_2 = RemapNumbers(Value=panel, Source=bounds_2, Target=construct_domain)  # -> Mapped, Clipped
multiplication_2 = Multiplication(A=graph_mapper_3, B=Slider(0, range=0..100))
brep = Brep(cap_holes)
scale_nu = ScaleNU(Geometry=move_3.Geometry, Plane=average, ScaleX=remap_numbers_2.Mapped, ScaleY=remap_numbers_2.Mapped, ScaleZ=1)  # -> Geometry, Transform
unit_x_2 = UnitX(Factor=multiplication_2)
twist = Twist(Geometry=brep, Axis=line, Angle=Slider(2.6, range=0..10), Infinite=False, Rigid=False)
move_5 = Move(Geometry=scale_nu.Geometry, Motion=unit_x_2)  # -> Geometry, Transform
series_2 = Series(Start=0, Step=Slider(6.3, range=0..30), Count=number_slider)
rotate = Rotate(Geometry=move_5.Geometry, Angle=degrees(series_2), Plane=PlaneXY(0, 0, 0))  # -> Geometry, Transform
loft = Loft(Curves=rotate.Geometry, Options={Adjust=False, Closed=False, LoftEnds=0, LoftSimp=0, LoftType=0, Rebuild=10, Refit=0.01})
